# Grasshopper definition 1111_test.gh (Grasshopper 1.0.7)
# plug-ins: VolumeGeneratorBasedOnGraph

# // 代表N2
point = Point(Point(-128, 163, 0))
# // 代表E1
point_2 = Point(Point(-133, 87, 0))
point_3 = Point(Point(-159, 158, 0))
# // 代表W
# // 代表S
point_4 = Point(Point(-174, 122, 0))
point_5 = Point(Point(-98, 108, 0))
# // 代表N1
point_6 = Point(Point(-103, 142, 0))
merge = Merge(Data1=point_4, Data2=point_2, Data3=point_5, Data4=point_6, Data5=point, Data6=point_3)
point_7 = Point([Point(-174, 123, 0), Point(-139.7254121, 87.40785734, 0), Point(-97.02761901, 124.3107695, 0), Point(-107.5469207, 136.3854092, 0), Point(-119.6346799, 153.2947025, 0), Point(-138.2491307, 158.8896261, 0)])
panel = Panel(point_7)
point_8 = Point([Point(-135.4490472, 133.6098246, 0), Point(-147.9003699, 114.4173399, 0), Point(-121.3322609, 115.5276489, 0)])
point_list = PointList(Points=merge, Size=Slider(5, range=0..10))
panel_2 = Panel(point_8)
point_list_2 = PointList(Points=point_7, Size=Slider(9, range=0..10))
panel_3 = Panel("""W
S
E1
N1
E2
N2""")
file_path = FilePath("D:\毕业论文\VolumeGeneratorBasedOnGraph\VolumeGeneratorBasedOnGraph\测试文件夹\1024Test.csv")
constructgraph = ConstructGraph(CSVFilePath=file_path, VolumeNodePoints=point_8, BoundaryNodePoints=point_7, BoundaryNodeLabels=panel_3)
xy_plane = XYPlane(Origin=Point(0, 0, 0))
debuggraph = DebugGraph(Graph=constructgraph)  # -> DebugGraphNode, DebugGraphLoL
panel_4 = Panel(debuggraph.DebugGraphNode)
tutteconvexdrawing = TutteConvexDrawing(BasePlane=xy_plane, GraphOrGraphWithHM=constructgraph)  # -> GraphOrGraphWithHM, ConvexFaceBorders, SubGraph, GraphEdge
panel_5 = Panel(debuggraph.DebugGraphLoL)
debuggraph_2 = DebugGraph(Graph=tutteconvexdrawing.GraphOrGraphWithHM)  # -> DebugGraphNode, DebugGraphLoL
panel_6 = Panel(debuggraph_2.DebugGraphNode)
triangulate = Triangulate(
    Graph=tutteconvexdrawing.GraphOrGraphWithHM,
    ConvexFaceBorders=tutteconvexdrawing.ConvexFaceBorders,
    IndexOfTriangularMesh=Slider(0, range=0..100),
    ExcludeDegenerateTINS=Toggle(True))  # -> AllTriangularMeshes, TheChosenGraphWithHM
panel_7 = Panel(debuggraph_2.DebugGraphLoL)
decomposevertex = DecomposeVertex(GraphWithHM=triangulate.TheChosenGraphWithHM, IndexOfGraphWithHM=Slider(0, range=0..100))  # -> CountOfAllPossibleHFM, NewGraphWithHM, DebugVerticesOutput, DebugHalfedgesOutput, DebugFacesOutput, DebugFacesHalfedges
line = Line(Line((30, 50, 0), (30, 30, 0)))
line_2 = Line(Line((40, 40, 0), (50, 40, 0)))
line_3 = Line(Line((40, 40, 0), (40, 50, 0)))
line_4 = Line(Line((30, 50, 0), (40, 50, 0)))
line_5 = Line(Line((50, 40, 0), (50, 30, 0)))
line_6 = Line(Line((30, 30, 0), (50, 30, 0)))
constructboundarysegment = ConstructBoundarySegment(SelectedBoundaryPolylineSegment=line_4, SegmentLabel="N2")
constructboundarysegment_2 = ConstructBoundarySegment(SelectedBoundaryPolylineSegment=line_2, SegmentLabel="N1")
constructboundarysegment_3 = ConstructBoundarySegment(SelectedBoundaryPolylineSegment=line_3, SegmentLabel="E2")
constructboundarysegment_4 = ConstructBoundarySegment(SelectedBoundaryPolylineSegment=line_5, SegmentLabel="E1")
constructboundarysegment_5 = ConstructBoundarySegment(SelectedBoundaryPolylineSegment=line_6, SegmentLabel="S")
constructboundarysegment_6 = ConstructBoundarySegment(SelectedBoundaryPolylineSegment=line, SegmentLabel="W")
xy_plane_2 = XYPlane(Origin=Point(0, 0, 0))
merge_2 = Merge(
    Data1=constructboundarysegment_6,
    Data2=constructboundarysegment_5,
    Data3=constructboundarysegment_4,
    Data4=constructboundarysegment_2,
    Data5=constructboundarysegment_3,
    Data6=constructboundarysegment)
tutteconvexdrawing_2 = TutteConvexDrawing(BasePlane=xy_plane_2)  # -> GraphOrGraphWithHM, ConvexFaceBorders, SubGraph, GraphEdge
debuggraph_3 = DebugGraph(Graph=tutteconvexdrawing_2.GraphOrGraphWithHM)  # -> DebugGraphNode, DebugGraphLoL
curve = Curve(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)
explode = Explode(Curve=curve, Recursive=True)  # -> Segments, Vertices
showgraph = ShowGraph(
    PlanktonMeshOrGraphWithHFMesh=tutteconvexdrawing_2.GraphOrGraphWithHM,
    OffsetDistance=Slider(0.8, range=0..3),
    ScreenSize=Slider(32, range=0..50),
    RelativeSize=Slider(0, range=0..1))
panel_8 = Panel(debuggraph_3.DebugGraphNode)
list_item = ListItem(List=explode.Segments, Index="5", Wrap=True)
list_item_2 = ListItem(List=explode.Segments, Index="4", Wrap=True)
list_item_3 = ListItem(List=explode.Segments, Index=" 0", Wrap=True)
list_item_4 = ListItem(List=explode.Segments, Index="3", Wrap=True)
list_item_5 = ListItem(List=explode.Segments, Index="2", Wrap=True)
list_item_6 = ListItem(List=explode.Segments, Index="1", Wrap=True)
dualusinghalfedge = DualUsingHalfedge()  # -> DualHalfedgeMesh, DebugVerticesOutput, DebugHalfedgesOutput, DebugFacesOutput, DebugFacesHalfedges, FaceIndexsFromOuterNodes
line_7 = Line(list_item_3)
line_8 = Line(list_item_4)
line_9 = Line(list_item_5)
line_10 = Line(list_item_2)
line_11 = Line(list_item)
line_12 = Line(list_item_6)
constructboundarysegment_7 = ConstructBoundarySegment(SelectedBoundaryPolylineSegment=line_11, SegmentLabel="N2")
constructboundarysegment_8 = ConstructBoundarySegment(SelectedBoundaryPolylineSegment=line_8, SegmentLabel="N1")
constructboundarysegment_9 = ConstructBoundarySegment(SelectedBoundaryPolylineSegment=line_10, SegmentLabel="E2")
constructboundarysegment_10 = ConstructBoundarySegment(SelectedBoundaryPolylineSegment=line_9, SegmentLabel="E1")
constructboundarysegment_11 = ConstructBoundarySegment(SelectedBoundaryPolylineSegment=line_12, SegmentLabel="S")
constructboundarysegment_12 = ConstructBoundarySegment(SelectedBoundaryPolylineSegment=line_7, SegmentLabel="W")
merge_3 = Merge(
    Data1=constructboundarysegment_12,
    Data2=constructboundarysegment_11,
    Data3=constructboundarysegment_10,
    Data4=constructboundarysegment_8,
    Data5=constructboundarysegment_9,
    Data6=constructboundarysegment_7)
reorganizeboundary = ReorganizeBoundary(BoundarySegments=merge_3)  # -> BoundaryCorner, ReorganizedBoundary, ReorganizedCornerIndex
