# Grasshopper definition 1221.gh (Grasshopper 1.0.7)
# plug-ins: VolumeGeneratorBasedOnGraph

panel = Panel("""W
S
E
N""")
point = Point([Point(0, 25, 0), Point(-24, -1, 0), Point(15, -9, 0)])
point_2 = Point([Point(-58.07877569, -0.1938198873, 0), Point(1.315160513, -41.54792591, 0), Point(52.69083492, -0.1938198873, 0), Point(-1.182268104, 47.28917775, 0)])
file_path = FilePath("D:\毕业论文\VolumeGeneratorBasedOnGraph\VolumeGeneratorBasedOnGraph\测试文件夹\1221Test.csv")
constructgraph = ConstructGraph(CSVFilePath=file_path, VolumeNodePoints=point, BoundaryNodePoints=point_2, BoundaryNodeLabels=panel)
tutteconvexdrawing = TutteConvexDrawing(Graph=constructgraph)  # -> Graph, ConvexFaceBorders, SubGraph, GraphEdge
curve = Curve(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)
explode = Explode(Curve=curve, Recursive=True)  # -> Segments, Vertices
list_item = ListItem(List=explode.Segments, Index=" 0", Wrap=True)
list_item_2 = ListItem(List=explode.Segments, Index="3", Wrap=True)
list_item_3 = ListItem(List=explode.Segments, Index="2", Wrap=True)
list_item_4 = ListItem(List=explode.Segments, Index="1", Wrap=True)
triangulate = Triangulate(
    Graph=tutteconvexdrawing.Graph,
    ConvexFaceBorders=tutteconvexdrawing.ConvexFaceBorders,
    IndexOfTriangularMesh=Slider(0, range=0..12),
    ExcludeDegenerateTINS=Toggle(True))
line = Line(list_item)
line_2 = Line(list_item_2)
line_3 = Line(list_item_3)
line_4 = Line(list_item_4)
constructboundarysegment = ConstructBoundarySegment(SelectedBoundaryPolylineSegment=line_2, SegmentLabel="N")
constructboundarysegment_2 = ConstructBoundarySegment(SelectedBoundaryPolylineSegment=line_3, SegmentLabel="E")
constructboundarysegment_3 = ConstructBoundarySegment(SelectedBoundaryPolylineSegment=line_4, SegmentLabel="S")
constructboundarysegment_4 = ConstructBoundarySegment(SelectedBoundaryPolylineSegment=line, SegmentLabel="W")
dualusinghalfedge2 = DualUsingHalfedge2(GraphWithHM=triangulate)
merge = Merge(
    Data1=constructboundarysegment_4,
    Data2=constructboundarysegment_3,
    Data3=constructboundarysegment_2,
    Data4=constructboundarysegment)
reorganizeboundary3 = ReorganizeBoundary3(DualGraphWithHM=dualusinghalfedge2, BoundarySegments=merge)  # -> SortedBoundarySegments, VerticesIndexForEachBS, IndexOnEachBS, VolumeJunctionsTexts, NeedToConnectVolumeJunctionsIndex, NeedToConnectBSIndex, NeedToConnectPairCorrespondingFaceIndex, BoundaryTCounts, InnerTMaxCounts
gene_pool = GenePool(Decimals=2, Maximum=1, Minimum=0, Value=0.27)
gene_pool_2 = GenePool(Decimals=2, Maximum=1, Minimum=0, Value=[0.67, 0.48, 0.59])
panel_2 = Panel("""1
1
1""")
panel_3 = Panel("""1
1
1""")
panel_4 = Panel("""1
1
1""")
panel_5 = Panel("""1
1
1""")
panel_6 = Panel("""1
1""")
panel_7 = Panel("""1
1
1""")
panel_8 = Panel("""1
1""")
panel_9 = Panel("""1
1
1""")
entwine = Entwine(Branch00=gene_pool_2, FlattenInputs=True)
entwine_2 = Entwine(Branch00=gene_pool, FlattenInputs=True)
ghcsitedivision3 = GhcSiteDivision3(
    DualGraphWithHM=dualusinghalfedge2,
    SortedBoundarySegments=reorganizeboundary3.SortedBoundarySegments,
    VerticesIndexForEachBS=reorganizeboundary3.VerticesIndexForEachBS,
    IndexOnEachBS=reorganizeboundary3.IndexOnEachBS,
    VolumeJunctionsTexts=reorganizeboundary3.VolumeJunctionsTexts,
    NeedToConnectVolumeJunctionsIndex=reorganizeboundary3.NeedToConnectVolumeJunctionsIndex,
    NeedToConnectBSIndex=reorganizeboundary3.NeedToConnectBSIndex,
    NeedToConnectPairCorrespondingFaceIndex=reorganizeboundary3.NeedToConnectPairCorrespondingFaceIndex,
    BoundaryTCounts=reorganizeboundary3.BoundaryTCounts,
    InnerTMaxCounts=reorganizeboundary3.InnerTMaxCounts,
    BoundaryTDT=entwine,
    InnerTMaxDT=entwine_2)  # -> TXDT, TYDT, DeBugPolyline
entwine_3 = Entwine(Branch00=panel_6, Branch01=panel_7, Branch02=panel_4, Branch03=panel_2, FlattenInputs=True)
entwine_4 = Entwine(Branch00=panel_8, Branch01=panel_9, Branch02=panel_5, Branch03=panel_3, FlattenInputs=True)
entwine_5 = Entwine(Branch0X=entwine_3, Branch1X=entwine_4, FlattenInputs=False)
explode_tree = ExplodeTree(Data=entwine_5)  # -> Branch0, Branch1, Branch2, Branch3, Branch4, Branch5, Branch6, Branch7
panel_10 = Panel(explode_tree.Branch1)
